# Grasshopper definition testFile.gh (Grasshopper 0.9.76)
# plug-ins: VirtualWindTunnel

brep = Brep(<brep referenced from the Rhino model>)
toggle = BooleanToggle(True)
stlexporter = STLExporter(Breps=brep, File="C:\OF\sdf.stl", Mode="0")
blockmesh = BlockMesh(Domain=brep, Run=toggle)
panel = Panel(toggle)
