# Grasshopper definition 4_AnnualWindAnalysis.ghx (Grasshopper 1.0.7)
# plug-ins: Eddy3D, Climate Studio: Archsim

# ----
# 1. Geometry &
# Boundary Conditions
# C:\Users\pkastner\Google Drive\Patrick\Papers\CPGenerator\Conference\Data\Weather\AUS_NSW.Dubbo.Airport.957190_RMY.epw
panel = Panel("C:\DIVA\WeatherData\USA_IL_Chicago-OHare.Intl.AP.725300_TMY3.epw")
panel_2 = Panel("""0
22
45
90
135
180
225
270
315""")
geo = Geometry([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])
abl = ABL(WDir=panel_2, Uref="10", Zref=10, Z0=1, ZGround=0, Epw=panel)

cluster = Cluster_4(mesh=geo)
# 5. Post-processing
# 5.1. Paraview
# 5.2. Grasshopper
button = Button()
dir = Slider(2, range=0..7)
# 5.3. Grasshopper
button_2 = Button()
# Pedestrian wind comfort (NEN8100)
number_slider = Slider(12, range=0..30)
Y = UnitY(Factor="200")
move = Move(Geometry=geo, Motion=Y)  # -> Geometry, Transform
cluster_2 = Cluster()  # -> S, E, data_3
gradient = Gradient(
    LowerLimit="0",
    UpperLimit="5",
    Parameter=cluster_2.data_3,
    stops=[0.103: RGB(0, 0, 255), 0.22: RGB(0, 170, 255), 0.305: RGB(0, 255, 255), 0.398: RGB(0, 255, 188), 0.504: RGB(0, 255, 106), 0.605: RGB(91, 255, 0), 0.699: RGB(184, 255, 0), 0.799: RGB(255, 255, 0), 0.898: RGB(255, 170, 0)])
weather = Weather(
    Location=panel,
    Input_0_Hidden=False,
    Input_0_Name="Location",
    Output_0_Hidden=False,
    Output_0_Name="Location",
    Output_10_Hidden=False,
    Output_10_Name="DiffuseHorizontalRadiation",
    Output_11_Hidden=True,
    Output_11_Name="GlobalHorizontalRadiation",
    Output_12_Hidden=True,
    Output_12_Name="SkyCover",
    Output_13_Hidden=True,
    Output_13_Name="Precipitation",
    Output_14_Hidden=True,
    Output_14_Name="Elev",
    Output_15_Hidden=True,
    Output_15_Name="Azimuth",
    Output_16_Hidden=True,
    Output_16_Name="Vector",
    Output_17_Hidden=True,
    Output_17_Name="Illuminance",
    Output_18_Hidden=True,
    Output_18_Name="DateTime",
    Output_19_Hidden=True,
    Output_19_Name="DryBulbAverages",
    Output_1_Hidden=True,
    Output_1_Name="Latitude",
    Output_20_Hidden=True,
    Output_20_Name="DewPointAverages",
    Output_21_Hidden=True,
    Output_21_Name="DryBulbMinima"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)  # -> Location, DryBulbTemp, RelativeHumidity, WindSpeed, WindDirection, DirectNormalRadiation, DiffuseHorizontalRadiation
panel_3 = Panel(weather.WindSpeed)
panel_4 = Panel(weather.WindDirection)
bar_graph = BarGraph(panel_3, BarColor=RGB(255, 0, 90))

# ----
# 2. Simulation Domain
number_slider_2 = Slider(50, range=0..1000)

domaincyl = CylindricalDomain(
    Geometry=geo,
    BoundaryCondition=abl,
    BlockSize="10",
    SizeOfInnerRectangle=number_slider_2,
    SizeOfOuterRadius=Slider(300, range=0..1000),
    Height=Slider(80, range=0..1000))  # -> Domain, Mesh

cellsize = CellSize(SimulationDomain=domaincyl.Domain, BlockSize="10", DesiredCellSize=Slider(3, range=0..10))

# ----
# 3. Mesh & Simulation
panel_5 = Panel("C:\test_cyl")
mset = MeshSettings(AccBuilding=cellsize, AccFeatures=cellsize, AccRefinement=0, AccGround=cellsize, NLayer=3, Mode=1, Mode_2=1)

rset = RunSettings(
    NumberOfIterations="200",
    WriteInterval=20,
    NumberOfTimestepsToKeep=3,
    TurbulenceModel=1,
    RelaxationFactors=3,
    SolutionAndAlgorithmControl=1,
    PotentialFoamInitialization=False,
    AgeOfAir=True,
    NumberOfCPUs="-1",
    OperatingSystem=0)
simulation = Simulation(
    SimulationDomain=domaincyl.Domain,
    WorkingDirectory=panel_5,
    MeshSettings=mset,
    RunSettings=rset,
    RunMeshing=Button(),
    MakeTrees=False,
    RunSimulation=Button(),
    runWithBlueCFD=True)
residuals = Residuals(Result=simulation, SelectionOfWindDirections="0", X=":", Y=":", Version=0, Run=Button(), visResiduals=False)

# ----
# 6. Clean
button_3 = Button()
clean = Clean(Directory=panel_5, Mode=2, Run=button_3)

paraview = Paraview(Result=simulation, ParaviewVersion=2, Run=button)

# ----
# 4. Probing points & probing
number_slider_3 = Slider(3, range=1..50)
brep = Brep(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)
meshplane = MeshPlane(brep=brep, number=number_slider_3, B=geo)  # -> L, faces

probing = Probing(BuildingMesh=cluster, Points=meshplane.L)

visprobes = VisualizeProbes(Result=simulation, ProbingPoints=probing, NameOfInstance="aoa", NameOfField=0, Run=Button())  # -> PorbingPoints, ProbingResult

vectors = Data(visprobes.ProbingResult)
points = Data(visprobes.PorbingPoints)
# Multi-directional / annual wind vectors
choose_dir = TreeBranch(Tree=vectors, Path=dir, MaintainPaths=True)
wind_factors = WindFactors(Result=simulation, ProbingPoints=points, WindVelocity=vectors, Run=button_2, Interpolation=True)  # -> WindFactors, AnnualWindVelocities
cluster_3 = Cluster(data=choose_dir)  # -> S, E, data_3
cluster_4 = Cluster_3(C=points, T=Y)
gradient_2 = Gradient(
    LowerLimit=cluster_3.S,
    UpperLimit=Slider(6, range=0..10),
    Parameter=cluster_3.data_3,
    stops=[0.103: RGB(0, 0, 255), 0.22: RGB(0, 170, 255), 0.305: RGB(0, 255, 255), 0.398: RGB(0, 255, 188), 0.504: RGB(0, 255, 106), 0.605: RGB(91, 255, 0), 0.699: RGB(184, 255, 0), 0.799: RGB(255, 255, 0), 0.898: RGB(255, 170, 0)])
dedata = DeconstructDataObjects(Data=wind_factors.AnnualWindVelocities)
flip = FlipMatrix(Data=dedata)
avr = Average(Input=flip)  # -> flatten(ArithmeticMean); disabled
branch = TreeBranch(Tree=flip, Path="1611", MaintainPaths=True)
wind_comfort = AnnualWindComfort(AnnualWindVelocities=wind_factors.AnnualWindVelocities, WindComfortIndex=4)  # disabled
vdisex = VectorDisplayEx(Point=points, Vector=choose_dir, Colour=gradient_2, Width=Slider(3, range=0..10))  # disabled
panel_6 = Panel(avr)
panel_7 = Panel(wind_comfort)
preview = CustomPreview(Geometry=cluster_4, Material=gradient)
data = Data([panel_3, branch])
bar_graph_2 = BarGraph(branch, BarColor=RGB(255, 0, 90))
xyplot = XYPlot(Type=3, Width=550, Height=450, X_data=panel_3, X_rot=0, Y_data=branch, Show_xgrid=False, Show_ygrid=True, Legend=0)

# ==== cluster MeshPlane
B = ClusterInput()
number = ClusterInput()
number_2 = Number(number)
settings_custom = SettingsCustom(
    StitchSeams=True,
    SimplePlanes=False,
    Refine=True,
    MinCount=16,
    MaxCount=400,
    AspectRatio=20,
    MaxDistance=0,
    MaxAngle=20,
    MinEdge=number_2,
    MaxEdge=number_2)
brep = ClusterInput()
mesh_brep = MeshBrep(Brep=brep, Settings=settings_custom)
deconstruct_mesh = DeconstructMesh(Mesh=mesh_brep)  # -> Vertices, Faces, Colours, Normals
brepsinc = PointInBreps(Brep=B, Point=deconstruct_mesh.Vertices, Strict=False)  # -> Inside, Index
not = GateNot(A=brepsinc.Inside)
cull = CullPattern(List=deconstruct_mesh.Vertices, CullPattern=not)
faces = ClusterOutput(deconstruct_mesh.Faces)
L = ClusterOutput(cull)

# ==== cluster Cluster
data = ClusterInput()
data_2 = Data(data)
data_3 = ClusterOutput(data_2)
bnd = Bounds(Numbers=data_2)
dedomain = DeconstructDomain(Domain=bnd)  # -> Start, End
S = ClusterOutput(dedomain.Start)
E = ClusterOutput(dedomain.End)

# ==== cluster Cluster_3
C = ClusterInput()
T = ClusterInput()
cluster = Cluster_2(C=C)
move = Move(Geometry=cluster, Motion=T)  # -> Geometry, Transform
G = ClusterOutput(move.Geometry)

# ==== cluster Cluster_4
mesh = ClusterInput()
mesh_2 = Mesh(mesh)
mjoin = MeshJoin(Meshes=mesh_2)
M = ClusterOutput(mjoin)

# ==== cluster Cluster_2
C = ClusterInput()
circle = CircleCNR(Center=C, Normal=Vector(0, 0, 1), Radius=2)
srf = Surface(circle)
srf_2 = ClusterOutput(srf)
